# Grasshopper definition gh_testSite_decoupling.gh (Grasshopper 1.0.7)
# plug-ins: TableUI

tableui = TableUIGH_Adapter(URL="https://magpietable-default-rtdb.firebaseio.com/", Expire="1000", Run=Toggle(True), Authorization="\"\"")
panel = Panel(tableui)
